# Grasshopper definition face-by-face_room.gh (Grasshopper 1.0.7)

research_lab = Geometry([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])
lab_support = Geometry([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])
conference = Geometry([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])
classroom = Geometry([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])
corridor = Geometry([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])
offices = Geometry([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])
wrietup = Geometry(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)
storage = Geometry([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])
toggle = BooleanToggle(True)
all_rooms = Geometry([offices, wrietup, conference, classroom, corridor, storage, research_lab, lab_support])
roomsolid = HBRoomFromSolid(geo=flatten(all_rooms), name=flatten("LabBuilding"), conditioned=True, run=toggle)  # -> report, rooms; plug-in component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
solveadj = HBSolveAdjacency(rooms=flatten(roomsolid.rooms), run=toggle)  # -> report, adj_rooms; plug-in component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

geo = Geometry(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)
geo_2 = Geometry(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)
geo_3 = Geometry(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)
geo_4 = Geometry(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)
door = HBDoor(geo=geo_2)  # -> report, doors; plug-in component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
aperture = HBAperture(geo=geo_3)  # -> report, apertures; plug-in component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
shade = HBShade(geo=geo)  # -> report, shades; plug-in component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
face = HBFace(geo=geo_4, name="Office1Face")  # -> report, faces; plug-in component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
addshade = HBAddShade(hb_obj=aperture.apertures, out_shades=flatten(shade.shades))  # -> hb_obj; plug-in component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
addsubface = HBAddSubface(hb_obj=face.faces, sub_faces=flatten([addshade, door.doors]))  # -> hb_obj; plug-in component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
room = HBRoom(faces=flatten(addsubface), name="Residence", conditioned=Toggle(True))  # -> report, room; plug-in component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

toggle_2 = BooleanToggle(True)
geo_5 = Geometry([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])
intsolid = HBIntersectSolids(solids=flatten(geo_5), run=toggle_2)  # -> int_solids; plug-in component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
geo_6 = Geometry([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])
roomsolid_2 = HBRoomFromSolid(geo=flatten(intsolid), name=flatten("office"), conditioned=True, run=toggle_2)  # -> report, rooms; plug-in component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
aperture_2 = HBAperture(geo=geo_6)  # -> report, apertures; plug-in component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
addsubface_2 = HBAddSubface(hb_obj=roomsolid_2.rooms, sub_faces=flatten(aperture_2.apertures))  # -> hb_obj; plug-in component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
solveadj_2 = HBSolveAdjacency(rooms=flatten(addsubface_2), run=toggle_2)  # -> report, adj_rooms; plug-in component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

decomposebytype = Honeybee_DecomposeBasedOnType()  # -> walls, interior_walls, roofs, ceilings, exterior_floors, interior_floors, air_walls, apertures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; plug-in component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

prevquick = HBPreviewQuick()  # -> geo; plug-in component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
vizbc = HBVisualizeByBC()  # -> outdoors, surface, ground, adiabatic, other; plug-in component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
prevall = HBPreviewAll()  # -> geo; plug-in component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

panel = Panel("https://www.energyplus.net/weather-download/north_and_central_america_wmo_region_4/USA/MA/USA_MA_Boston-Logan.Intl.AP.725090_TMY3/all")
vec = Vector(Vector(-3.794784231, 8.021495122, 0))
model = HBModel(rooms=flatten(solveadj.adj_rooms), north=vec, run=Toggle(True))  # -> report, model; plug-in component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
downloadweather = LadybugPlus_DownloadWeather(weather_URL=panel)  # -> epw_file, stat_file, ddy_file; plug-in component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
toggle_3 = BooleanToggle(False)
toidf = HBModelToIDF(model=model.model, epw_file=downloadweather.epw_file, write=toggle_3, run=toggle_3)  # -> report, idf, sql, eio, rdd, html; plug-in component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

python = GhPythonScript()  # -> centers, normals; inputs rooms: list; disabled
# ---------- python: Python ----------
from ladybug_rhino.fromgeometry import from_point3d, from_vector3d

centers = []
normals = []

for room in rooms:
    for face in room.faces:
        centers.append(from_point3d(face.center))
        normals.append(from_vector3d(face.normal))
# ---------- end python ----------
vdis = VectorDisplay(Anchor=python.centers, Vector=python.normals)  # disabled
