# Grasshopper definition model_creation_workflows.gh (Grasshopper 1.0.7)

# ----
# Solids-to-Rooms Workflow
toggle = BooleanToggle(True)
geo = Geometry([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])
intsolid = HBIntersectSolids(solids=flatten(geo), run=toggle)  # -> int_solids; plug-in component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
geo_2 = Geometry([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])
roomsolid = HBRoomFromSolid(geo=flatten(intsolid), name=flatten("Residence"), conditioned=True, run=toggle)  # -> report, rooms; plug-in component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
aperture = HBAperture(geo=geo_2)  # -> report, apertures; plug-in component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
bordershades = HBExtrudedBorderShades(hb_obj=flatten(aperture.apertures), depth="0.3", run=Toggle(True))  # -> report, hb_obj; plug-in component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
addsubface = HBAddSubface(hb_obj=roomsolid.rooms, sub_faces=flatten(bordershades.hb_obj))  # -> hb_obj; plug-in component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
geo_3 = Geometry([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])
solveadj = HBSolveAdjacency(rooms=flatten(addsubface), run=toggle)  # -> report, adj_rooms; plug-in component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
shade = HBShade(geo=geo_3)  # -> report, shades; plug-in component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
house_shades = Data(flatten(shade.shades))
house_rooms = Data(flatten(solveadj.adj_rooms))

# ----
# Object-by-Object Workflow
#            [High Customization]
panel = Panel("TinyHouseFace")
geo_4 = Geometry(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)
geo_5 = Geometry(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)
geo_6 = Geometry(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)
geo_7 = Geometry([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])
geo_8 = Geometry(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)
shade_2 = HBShade(geo=geo_4)  # -> report, shades; plug-in component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
aperture_2 = HBAperture(geo=geo_7)  # -> report, apertures; plug-in component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
aperture_3 = HBAperture(geo=geo_5)  # -> report, apertures; plug-in component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
door = HBDoor(geo=geo_8)  # -> report, doors; plug-in component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
face = HBFace(geo=geo_6, name=panel)  # -> report, faces; plug-in component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
addshade = HBAddShade(hb_obj=aperture_3.apertures, out_shades=flatten(shade_2.shades))  # -> hb_obj; plug-in component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
addsubface_2 = HBAddSubface(hb_obj=face.faces, sub_faces=flatten([addshade, door.doors, aperture_2.apertures]))  # -> hb_obj; plug-in component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
geo_9 = Geometry(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)
geo_10 = Geometry(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)
shade_3 = HBShade(geo=geo_9)  # -> report, shades; plug-in component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
shade_4 = HBShade(geo=geo_10)  # -> report, shades; plug-in component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
room = HBRoom(faces=flatten(addsubface_2), name="TinyHouse", conditioned=Toggle(True))  # -> report, room; plug-in component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
addshade_2 = HBAddShade(hb_obj=room.room, out_shades=flatten(shade_3.shades), in_shades=flatten(shade_4.shades))  # -> hb_obj; plug-in component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
tiny_house_room = Data(flatten(addshade_2))

facparam = HBFacadeParameters(north=0, east=Toggle(False), south=0, west=Toggle(True))  # -> fac_par; plug-in component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

facparam_2 = HBFacadeParameters(north="0", east="45", south="0", west="-45")  # -> fac_par; plug-in component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

facparam_3 = HBFacadeParameters(north="0.5", east="1", south="0.5", west="1")  # -> fac_par; plug-in component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

# ----
# Solids-to-Rooms Workflow
#                [High Automation]
research_lab = Geometry([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])
lab_support = Geometry([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])
conference = Geometry([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])
toggle_2 = BooleanToggle(True)
classroom = Geometry([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])
corridor = Geometry([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])
offices = Geometry([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])
wrietup = Geometry(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)
storage = Geometry([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])
all_rooms = Geometry([offices, wrietup, conference, classroom, corridor, storage, research_lab, lab_support])
roomsolid_2 = HBRoomFromSolid(geo=flatten(all_rooms), name=flatten("LabBuilding"), conditioned=True, run=toggle_2)  # -> report, rooms; plug-in component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
solveadj_2 = HBSolveAdjacency(rooms=flatten(roomsolid_2.rooms), run=toggle_2)  # -> report, adj_rooms; plug-in component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
aperturesbyratio = HBAperturesByRatio(hb_obj=solveadj_2.adj_rooms, ratio="0.35", glz_height="2.8", run=toggle_2)  # -> report, hb_obj; plug-in component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
louvershades = HBLouverShades(
    hb_obj=aperturesbyratio.hb_obj,
    depth=facparam_3,
    angle=facparam_2,
    vertical=Toggle(True),
    flip_start=facparam,
    run=toggle_2)  # -> report, hb_obj; plug-in component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

room_energy_attr = Honeybee_ZoneAttributeList({"Program": "properties.energy.program_type.name", "Construction Set": "properties.energy.construction_set.name", "Is Conditioned": "properties.energy.is_conditioned", "People per Area": "properties.energy.people.people_per_area", "Area per Person": "properties.energy.people.area_per_person", "Gas Equipment per Area": "properties.energy.gas_equipment.watts_per_area", "Occupancy Schedule": "properties.energy.people.occupancy_schedule.name", "Activity Schedule": "properties.energy.people.activity_schedule.name"}, selected="Area per Person")
room_attr = Honeybee_ZoneAttributeList({"Simulation Name": "name", "Display Name": "display_name", "Multiplier": "multiplier", "Volume": "volume", "Floor Area": "floor_area", "Exposed Area": "exposed_area", "Exterior Wall Area": "exterior_wall_area", "Exterior Aperture Area": "exterior_aperture_area", "Average Floor Height": "average_floor_height"}, selected="Simulation Name")

# ----
# Create a Model
toggle_3 = BooleanToggle(True)
model = HBModel(rooms=flatten(house_rooms), shades=flatten(house_shades), run=toggle_3)  # -> report, model; plug-in component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

# ----
# Edit
# Geometry
decnstrobj = HBDeconstructObject()  # -> faces, apertures, doors, shades; plug-in component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
scale = HBScale()  # -> hb_obj; plug-in component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
rotate = HBRotate()  # -> hb_obj; plug-in component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
reflect = HBReflect()  # -> hb_obj; plug-in component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
move = HBMove()  # -> hb_obj; plug-in component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

lablerooms = HBLabelRooms(rooms=flatten(tiny_house_room), attribute=room_energy_attr)  # -> label_text, base_pts, labels, wire_frame; plug-in component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
labelsurfaces = Honeybee_LabelZoneSurfaces()  # -> Label_text, Base_pts, Labels, Wire_frame

# ----
# Visualize
# Geometry
vizbytype = HBVisualizeByType()  # -> walls, interior_walls, roofs, ceilings, exterior_floors, interior_floors, air_walls, apertures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; plug-in component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
vizbybc = HBVizualizeByBC()  # -> outdoors, surface, ground, adiabatic, other; plug-in component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
vizall = HBVizualizeAll()  # -> geo; plug-in component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
vizquick = HBVizualizeQuick()  # -> geo; plug-in component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

bldg_vintage = Dragonfly_BldgAge({"ASHRAE 90.1 2013  |  IECC 2015": "2013", "ASHRAE 90.1 2010  |  IECC 2012": "2010", "ASHRAE 90.1 2007  |  IECC 2009": "2007", "ASHRAE 90.1 2004  |  IECC 2006": "2004", "1980-2004 (CBECS)": "1980_2004", "Pre-1980 (CBECS)": "pre_1980"}, selected="ASHRAE 90.1 2013  |  IECC 2015")
bldg_programs = Honeybee_bldgPrograms({"LargeOffice", "MediumOffice", "SmallOffice", "MidriseApartment", "HighriseApartment", "Retail", "StripMall", "PrimarySchool", "SecondarySchool", "SmallHotel", "LargeHotel", "Hospital", "Outpatient", "Laboratory", "Warehouse", "SuperMarket", "FullServiceRestaurant", "QuickServiceRestaurant", "Courthouse", "LargeDataCenterHighITE", "LargeDataCenterLowITE", "SmallDataCenterHighITE", "SmallDataCenterLowITE"}, selected="LargeOffice")
climate_zone = Dragonfly_BldgAge({"1 - Very Hot": "1", "2 - Hot": "2", "3 - Warm": "3", "4 - Mixed": "4", "5 - Cool": "5", "6 - Cold": "6", "7 - Very Cold": "7", "8 - Subarctic": "8"}, selected="5 - Cool")
constr_type = Dragonfly_BldgAge({"SteelFramed", "WoodFramed", "Mass", "Metal Building"}, selected="SteelFramed")
searchconstrset = HBSearchConstructionSets(climate_zone=climate_zone, constr_type=constr_type)  # -> constr_set; plug-in component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
searchprog = HBSearchPrograms(bldg_prog=bldg_programs, vintage=bldg_vintage)  # -> room_prog; plug-in component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
panel_2 = Panel(searchconstrset)
panel_3 = Panel(searchprog)

panel_4 = Panel("https://www.energyplus.net/weather-download/north_and_central_america_wmo_region_4/USA/MA/USA_MA_Boston-Logan.Intl.AP.725090_TMY3/all")
downloadweather = LadybugPlus_DownloadWeather(weather_URL=panel_4)  # -> epw_file, stat_file, ddy_file; plug-in component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
toggle_4 = BooleanToggle(False)
modeltoidf = HBModelToIDF(epw_file=downloadweather.epw_file, write=toggle_4, run=toggle_4)  # -> report, idf, sql, eio, rdd, html; plug-in component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

createuo = LBCreateUserObject(folder="c:\ladybug\export_test", change_type="fix", export=Toggle(False))  # -> read_me; plug-in component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

decnstrobj_2 = HBDeconstructObject()  # -> faces, apertures, doors, shades; disabled; plug-in component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
python = GhPythonScript(geo=decnstrobj_2.apertures)  # -> center, normal, clock; disabled
# ---------- python: Python ----------
from ladybug_rhino.fromgeometry import from_point3d, from_vector3d

if geo:
    center = from_point3d(geo.center)
    normal = from_vector3d(geo.normal)
    clock = geo.geometry.is_clockwise
# ---------- end python ----------
vdis = VectorDisplay(Anchor=python.center, Vector=python.normal)  # disabled
