# Grasshopper definition model_serialization.gh (Grasshopper 1.0.7)

# ----
# Create New Model
panel = Panel("TinyHouseFace")
geo = Geometry(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)
geo_2 = Geometry(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)
geo_3 = Geometry(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)
geo_4 = Geometry([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])
geo_5 = Geometry(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)
aperture = HBAperture(geo=geo_4)  # -> report, apertures; plug-in component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
aperture_2 = HBAperture(geo=geo_2)  # -> report, apertures; plug-in component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
shade = HBShade(geo=geo)  # -> report, shades; plug-in component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
door = HBDoor(geo=geo_5)  # -> report, doors; plug-in component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
face = HBFace(geo=geo_3, name=panel)  # -> report, faces; plug-in component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
addshade = HBAddShade(hb_obj=aperture_2.apertures, out_shades=flatten(shade.shades))  # -> hb_obj; plug-in component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
addsubface = HBAddSubface(hb_obj=face.faces, sub_faces=flatten([addshade, door.doors, aperture.apertures]))  # -> hb_obj; plug-in component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
geo_6 = Geometry(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)
geo_7 = Geometry(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)
shade_2 = HBShade(geo=geo_6)  # -> report, shades; plug-in component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
shade_3 = HBShade(geo=geo_7)  # -> report, shades; plug-in component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
room = HBRoom(faces=flatten(addsubface), name="TinyHouse", conditioned=Toggle(True))  # -> report, room; plug-in component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
addshade_2 = HBAddShade(hb_obj=room.room, out_shades=flatten(shade_2.shades), in_shades=flatten(shade_3.shades))  # -> hb_obj; plug-in component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
model = HBModel(rooms=flatten(addshade_2), name="Tiny House")  # -> report, model; plug-in component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

# ----
# Create New ProgramType
panel_2 = Panel("SchoolSecondary HTGSETP_SCH_YES_OPTIMUM")
setpoint = HBSetpoint(name="University Setpoint", heating_sch=panel_2, cooling_sch="SchoolSecondary CLGSETP_SCH_NO_SETBACK")  # -> setpoint; plug-in component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
ventilation = HBVentilation(name="University Ventilation", flow_per_person="0.01")  # -> vent; plug-in component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
infiltration = HBInfiltration(name="University Infiltration", flow_per_ext_area="0.0003")  # -> infil; plug-in component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
lighting = HBLighting(name="University Lighting", watts_per_area="6", schedule="SchoolPrimary BLDG_LIGHT_GYM_SCH")  # -> lighting; plug-in component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
people = HBPeople(name="University People", ppl_per_area="0.05", occupancy_sch="PrimarySchool Bldg Occ")  # -> people; plug-in component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
equipment = HBEquipment(name="University Equipment", watts_per_area="5", schedule="SchoolPrimary BLDG_EQUIP_SCH_2010")  # -> equip; plug-in component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
programtype = HBProgramType(
    name="University Classroom",
    people=people,
    lighting=lighting,
    electric_equip=equipment,
    infiltration=infiltration,
    ventilation=ventilation,
    setpoint=setpoint)  # -> program; plug-in component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

objtostr = HBObjectToString(hb_obj=programtype)  # -> hb_str; plug-in component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
programtype_string_representation = Panel(objtostr)
strtoobj = HBStringToObject(hb_str=objtostr)  # -> hb_obj; plug-in component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
panel_3 = Panel(strtoobj)

dumpobjects = HBDumpObjects(hb_objs=flatten(model.model), dump=Toggle(False))  # -> report, hb_file; plug-in component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
honeybee_json_file_path = Panel(dumpobjects.hb_file)
loadobjects = HBLoadObjects(hb_file=dumpobjects.hb_file, load=Toggle(False))  # -> report, hb_objs; plug-in component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
